# Grasshopper definition S2-intro-to-graphs.gh (Grasshopper 1.0.8)
# plug-ins: Pufferfish, DendroGH

number_slider = Slider(7.519, range=0..10)
rectangle = Rectangle(Plane=PlaneXY(0, 0, 0), XSize=number_slider, YSize=number_slider, Radius=0)  # -> Rectangle, Length
boxrec = BoxRectangle(Rectangle=rectangle.Rectangle, Height=Slider(7, range=0..10))
pop3d = Populate3D(Region=boxrec, Count=Slider(16, range=0..100), Seed=1)
prox = Proximity3D(Points=pop3d, Group=Slider(2, range=0..10))  # -> Links, Topology
list = ValueList({"graphs-01-intro": 0, "graphs-02-graph-from-mesh": 1, "graphs-03-with-data": 2, "graphs-04-dual-graph": 3, "graphs-05-shorest-paths": 4}, selected="graphs-05-shorest-paths")
vsettings = CreateSettings(VoxelSize=Slider(0.3, range=0..1), Bandwidth=1, Isovalue=0, Adaptivity=0.1)
graphs_02_graph_from_mesh = FilePath("I:\Mi unidad\_MPDA\AT\AP\Session 2\session02\graphs\graphs-02-graph-from-mesh.py")
graphs_05_shorest_paths = FilePath("I:\Mi unidad\_MPDA\AT\AP\MPDA25-Assignment3\graphs-05-shorest-paths.py")
graphs_04_dual_graph = FilePath("I:\Mi unidad\_MPDA\AT\AP\Session 2\session02\graphs\graphs-04-dual-graph.py")
graphs_03_with_data = FilePath("I:\Mi unidad\_MPDA\AT\AP\Session 2\session02\graphs\graphs-03-with-data.py")
vcurve = CurveToVolume(Curves=flatten(prox.Links), CurveRadius=Slider(1.3, range=0..10), Settings=vsettings)
graphs_01_intro = FilePath("I:\Mi unidad\_MPDA\AT\AP\Session 2\session02\graphs\graphs-01-intro.py")
vsmooth = SmoothVolume(Volume=vcurve, Width=Slider(1.07, range=0..10), Type=Slider(0, range=0..3), Iterations=Slider(2, range=0..10))
filter = StreamFilter(
    Gate=list,
    Stream0=graphs_01_intro,
    Stream1=graphs_02_graph_from_mesh,
    Stream2=graphs_03_with_data,
    Stream3=graphs_04_dual_graph,
    Stream4=graphs_05_shorest_paths)
mvolume = VolumeToMesh(Volume=vsmooth, VolumeSettings=vsettings)
panel = Panel(filter)
file = ReadFile(File=filter, PerLineParse=False)
triremesh = TriRemesh(Geometry=mvolume, Length=Slider(0.6, range=0.15..0.6), Iterations=25)  # -> Triangulation, Dual, Creases
py3 = Python3Script(script=file, m=triremesh.Triangulation)  # -> out, a, b, c; inputs m: Mesh; unedited script template
py3_2 = Python3Script()  # -> out, a; unedited script template
crv = Curve(<curve referenced from the Rhino model>)
pline2msh = PolylineToMesh(Polyline=crv, Quadrangulate=True)
mc = MeshCorners(Mesh=pline2msh, Angle=2.35619449)
crv_cp = CurveClosestPoint(Point=mc, Curve=crv)  # -> Point, Parameter, Distance
shatter = Shatter(Curve=crv, Parameters=crv_cp.Parameter)
dispatch = Dispatch(List=shatter, DispatchPattern=[True, False])  # -> ListA, ListB
dispatch_2 = Dispatch(List=dispatch.ListA, DispatchPattern=[True, False])  # -> ListA, ListB
flip = FlipCurve(Curve=dispatch_2.ListB)  # -> Curve, Flag
twn2crvs = TweenTwoCurves(CurveA=dispatch_2.ListA, CurveB=flip.Curve, Factor=0.5, Refit=0, PointSample=0)
len = Length(Curve=twn2crvs)
