# Grasshopper definition S4-graph-walker-custom_CouzierOsorioSola.gh (Grasshopper 1.0.8)
# plug-ins: MeshEdit Components, Weaverbird

number_slider = Slider(3, range=0..10)
graphs_05_walker_custom_py = FilePath("I:\Mi unidad\_MPDA\AT\AP\MPDA25-Session04\graphs\graphs-05-walker-custom.py")
make_sure_is_the_right_path = Panel(graphs_05_walker_custom_py)
quadmesh = Mesh(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)
trimesh = Mesh(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)
mplane = MeshPlane(
    Boundary={Plane=PlaneXY(0, 0, 0), Size=Domain2(u=-10..10, v=-10..10)},
    WidthCount=number_slider,
    HeightCount=number_slider)  # -> Mesh, Area
restart = Button()
input_mesh = Mesh(trimesh)
mesh = Mesh(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)
file = ReadFile(File=graphs_05_walker_custom_py, PerLineParse=False)
py3 = Python3Script(restart=restart, m=mesh)  # -> out, a; inputs restart: Boolean, m: Mesh
# ---------- py3: Python ----------
import scriptcontext as sc


if restart:
    sc.sticky["mesh"] = m
    ghdoc = ghenv.Component.OnPingDocument()
    # ghdoc.ExpireSolution(False)    

a = m
# ---------- end py3 ----------
py3_2 = Python3Script()  # -> out, a
# ---------- py3_2: Python ----------
import scriptcontext as sc

a =  sc.sticky["mesh"]
# ---------- end py3_2 ----------
input_mesh_2 = Mesh(py3_2.a)
graphs_05_walker_custom_py_2 = FilePath("I:\Mi unidad\_MPDA\AT\AP\MPDA25-Assignment3\Assignment03_CouzierOsorioSola.py")
py3_3 = Python3Script(script=file, m=input_mesh_2, s=Slider(0, range=0..10))  # -> out, a, b, c, d; inputs m: Mesh, s: Int32; unedited script template
make_sure_is_the_right_path_2 = Panel(graphs_05_walker_custom_py_2)
explode = MeshExplode(Mesh=input_mesh_2, Interpolate=False)
all_shortest_paths = Data(py3_3.c)
item = ListItem(List=explode, Index=all_shortest_paths, Wrap=True)
file_2 = ReadFile(File=graphs_05_walker_custom_py_2, PerLineParse=False)
demesh = DeconstructMesh(Mesh=input_mesh_2)  # -> Vertices, Faces, Colours, Normals
clean = CombineClean(Meshes=item)  # -> flatten(Mesh)
unroller = Unroller(Strip=clean, Unroll=1)
conmesh = ConstructMesh(Vertices=demesh.Vertices, Faces=graft(demesh.Faces), Colours=demesh.Colours)
number_slider_2 = Slider(50, range=0..100)
py3_4 = Python3Script(script=file_2, m=input_mesh_2, i=py3_3.c)  # -> out, remap_length, remap_avrg_distance, grade, max_index, chosen_path; inputs m: Mesh, i: tree of Int32; unedited script template
wbvertices = WeaverbirdsVerticesComponent(MeshClosedPolylinesGroup=unroller, Weld=True)
cullvertices = MeshCullUnusedVertices()
item_2 = ListItem(List=flatten(conmesh), Index=all_shortest_paths, Wrap=True)
fline = FitLine(Points=wbvertices)
crv_cp = CurveClosestPoint(Point=wbvertices, Curve=fline)  # -> Point, Parameter, Distance
clean_2 = CombineClean(Meshes=item_2)
avr = Average(Input=crv_cp.Distance)
subtraction = Subtraction(A="100", B=number_slider_2)
dom = ConstructDomain(DomainStart=0, DomainEnd=number_slider_2)
panel = Panel(py3_4.grade)
bnd = Bounds(Numbers=flatten(avr))
panel_2 = Panel(avr)
dom_2 = ConstructDomain(DomainStart=subtraction, DomainEnd="0")
unroller_2 = Unroller(Strip=clean_2, Unroll=Slider(1, range=0..1))
remap = RemapNumbers(Value=flatten(avr), Source=bnd, Target=dom_2)  # -> Mapped, Clipped
panel_3 = Panel(py3_4.remap_length)
item_3 = ListItem(List=flatten(unroller_2), Index=Slider(420, range=0..1000), Wrap=True)
panel_4 = Panel(py3_4.remap_avrg_distance)
demesh_2 = DeconstructMesh(Mesh=input_mesh_2)  # -> Vertices, Faces, Colours, Normals
demesh_3 = DeconstructMesh(Mesh=input_mesh_2)  # -> Vertices, Faces, Colours, Normals
demesh_4 = DeconstructMesh(Mesh=input_mesh_2)  # -> Vertices, Faces, Colours, Normals
demesh_5 = DeconstructMesh(Mesh=input_mesh_2)  # -> Vertices, Faces, Colours, Normals
conmesh_2 = ConstructMesh(Vertices=demesh_3.Vertices, Faces=graft(demesh_3.Faces))  # -> flatten(Mesh)
cull_i = CullIndex(List=demesh_2.Faces, Indices=py3_4.chosen_path, Wrap=True)
panel_5 = Panel(remap.Mapped)
conmesh_3 = ConstructMesh(Vertices=demesh_5.Vertices, Faces=graft(demesh_5.Faces))  # -> flatten(Mesh)
conmesh_4 = ConstructMesh(Vertices=demesh_2.Vertices, Faces=graft(cull_i))  # -> flatten(Mesh)
item_4 = ListItem(List=conmesh_2, Index=py3_4.chosen_path, Wrap=True)
clean_3 = CombineClean(Meshes=conmesh_4)
clean_4 = CombineClean(Meshes=item_4)
unroller_3 = Unroller(Strip=clean_4, Unroll=1)
py3_5 = Python3Script(m=clean_3)  # -> out, a; inputs m: Mesh
# ---------- py3_5: Python ----------
import scriptcontext as sc


sc.sticky["mesh"] = m
# ---------- end py3_5 ----------
preview = CustomPreview(Geometry=clean_3, Material=ColourSwatch(SwatchColor=RGBA(156, 156, 156, 109)))
rec = DataRecorder(unroller_3, DataLimit=-10, RecordData=True)
Z = UnitZ(Factor=Slider(19, range=0..100))
Z_2 = UnitZ(Factor=Slider(19, range=0..100))
move = Move(Geometry=rec, Motion=Z)  # -> Geometry, Transform

# ---- group: custom logic
lng = ListLength(List=all_shortest_paths)
tstat = TreeStatistics(Tree=all_shortest_paths)  # -> Paths, Length, Count

# ----
bnd_2 = Bounds(Numbers=flatten(lng))
remap_2 = RemapNumbers(Value=flatten(lng), Source=bnd_2, Target=dom)  # -> Mapped, Clipped
addition = Addition(A=remap_2.Mapped, B=remap.Mapped)
panel_6 = Panel(addition)

# ---- group: custom logic (continued)
sort = SortList(Keys=addition, ValuesA=tstat.Paths)  # -> reverse(Keys), reverse(ValuesA)
item_5 = ListItem(List=sort.ValuesA, Index=0, Wrap=True)
# a sequence of indexes of faces
branch = TreeBranch(Tree=all_shortest_paths, Path=item_5, MaintainPaths=True)

# ----
chosen_path = Data(branch)
cull_i_2 = CullIndex(List=demesh_4.Faces, Indices=chosen_path, Wrap=True)
conmesh_5 = ConstructMesh(Vertices=demesh_4.Vertices, Faces=graft(cull_i_2))  # -> flatten(Mesh)
item_6 = ListItem(List=conmesh_3, Index=chosen_path, Wrap=True)
clean_5 = CombineClean(Meshes=conmesh_5)
clean_6 = CombineClean(Meshes=item_6)
unroller_4 = Unroller(Strip=clean_6, Unroll=1)
py3_6 = Python3Script(m=clean_5)  # -> out, a; inputs m: Mesh; same code as py3_5
preview_2 = CustomPreview(Geometry=clean_5, Material=ColourSwatch(SwatchColor=RGBA(156, 156, 156, 109)))
rec_2 = DataRecorder(unroller_4, DataLimit=-10, RecordData=True)
move_2 = Move(Geometry=rec_2, Motion=Z_2)  # -> Geometry, Transform
